# Grasshopper definition test.gh (Grasshopper 1.0.7)
# Copyright: 2021
# plug-ins: ImageClipboard, BitmapComponent

image = ClipboardImage(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)
c_script = CSharpScript()  # -> out, A
# ---------- c_script: C# usings ----------
using System.Reflection;
# ---------- c_script: C# ----------
    var modules = Grasshopper.Instances.ComponentServer.Libraries;
    foreach (GH_AssemblyInfo item in modules)
    {
      //Print(item.Name);
      if(item.Name == "BitmapComponent")
      {
        Assembly bmpAssembly = item.Assembly;

        Object o = bmpAssembly.CreateInstance("GrasshopperBitmapParam", false,
          BindingFlags.ExactBinding,
          null, new Object[] { 2 }, null, null);

        A = o;
      }
    }
# ---------- end c_script ----------
bmp = Bitmap(image)
panel = Panel(c_script.A)
panel_2 = Panel(c_script.out)
